# Grasshopper definition gh_to_b3d_MoveCamera_on_3DPath.ghx (Grasshopper 0.9.76)
# plug-ins: GH_CPython

crv = Curve(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)
crv_2 = Curve(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)
end = EndPoints(Curve=crv)  # -> Start, End
end_2 = EndPoints(Curve=crv_2)  # -> Start, End
reb = RebuildCurve(Curve=crv_2, Count=10, Tangents=False)
crv_3 = Curve(reb)
pt = Point("0,0,0")
divide = DivideCurve(Curve=crv, Count=Slider(360, range=0..1000), Kinks=False)  # -> Points, Tangents, Parameters
divide_2 = DivideCurve(Curve=crv_3, Count=Slider(360, range=0..1000), Kinks=False)  # -> Points, Tangents, Parameters
shift = ShiftList(List=divide_2.Points, Shift=1, Wrap=True)
shift_2 = ShiftList(List=divide.Points, Shift=1, Wrap=True)
ln = Line(StartPoint=divide.Points, EndPoint=shift_2)
ln_2 = Line(StartPoint=divide_2.Points, EndPoint=pt)
Z = UnitZ(Factor=1)
Z_2 = UnitZ(Factor=1)
end_3 = EndPoints(Curve=ln)  # -> Start, End
end_4 = EndPoints(Curve=ln_2)  # -> Start, End
ln_3 = Line(StartPoint=divide.Points, EndPoint=shift_2)
ln_4 = Line(StartPoint=divide_2.Points, EndPoint=pt)
xy = XYPlane(Origin=Point(0, 0, 0))
move = Move(Geometry=end_3.Start, Motion=Z)  # -> Geometry, Transform
xy_2 = XYPlane(Origin=Point(0, 0, 0))
move_2 = Move(Geometry=end_4.Start, Motion=Z_2)  # -> Geometry, Transform
vec2pt = Vector2Pt(PointA=end_3.Start, PointB=end_3.End, Unitize=False)  # -> Vector, Length
vec2pt_2 = Vector2Pt(PointA=end_4.Start, PointB=end_4.End, Unitize=False)  # -> Vector, Length
devec = DeconstructVector(Vector=vec2pt.Vector)  # -> XComponent, YComponent, ZComponent
devec_2 = DeconstructVector(Vector=vec2pt_2.Vector)  # -> XComponent, YComponent, ZComponent
project = Project(Geometry=ln_3, Plane=xy)  # -> Geometry, Transform
project_2 = Project(Geometry=ln_4, Plane=xy_2)  # -> Geometry, Transform
vec = VectorXYZ(XComponent=devec.XComponent, YComponent=devec.YComponent, ZComponent=0)  # -> Vector, Length
move_3 = Move(Geometry=end_3.Start, Motion=vec.Vector)  # -> Geometry, Transform
pl_3pt = Plane3Pt(PointA=end_3.Start, PointB=move.Geometry, PointC=move_3.Geometry)
vec_2 = VectorXYZ(XComponent=devec_2.XComponent, YComponent=devec_2.YComponent, ZComponent=0)  # -> Vector, Length
move_4 = Move(Geometry=end_4.Start, Motion=vec_2.Vector)  # -> Geometry, Transform
pl_3pt_2 = Plane3Pt(PointA=end_4.Start, PointB=move_2.Geometry, PointC=move_4.Geometry)
end_5 = EndPoints(Curve=ln_3)  # -> Start, End
end_6 = EndPoints(Curve=ln_4)  # -> Start, End
end_7 = EndPoints(Curve=project.Geometry)  # -> Start, End
end_8 = EndPoints(Curve=project_2.Geometry)  # -> Start, End
ln_5 = Line(StartPoint=end_3.Start, EndPoint=move_3.Geometry)
X = UnitX(Factor=1)
ln_6 = Line(StartPoint=end_4.Start, EndPoint=move_4.Geometry)
X_2 = UnitX(Factor=1)
move_5 = Move(Geometry=end_7.Start, Motion=X)  # -> Geometry, Transform
move_6 = Move(Geometry=end_8.Start, Motion=X_2)  # -> Geometry, Transform
angle = Angle(VectorA=ln_5, VectorB=ln, Plane=pl_3pt)  # -> Angle, Reflex
angle_2 = Angle(VectorA=ln_6, VectorB=ln_2, Plane=pl_3pt_2)  # -> Angle, Reflex
ln_7 = Line(StartPoint=end_7.Start, EndPoint=end_7.End)
ln_8 = Line(StartPoint=end_7.Start, EndPoint=move_5.Geometry)
ln_9 = Line(StartPoint=end_8.Start, EndPoint=end_8.End)
ln_10 = Line(StartPoint=end_8.Start, EndPoint=move_6.Geometry)
xy_3 = XYPlane(Origin=end_7.Start)
xy_4 = XYPlane(Origin=end_8.Start)
brep = Brep(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)
debrep = DeconstructBrep(Brep=brep)  # -> Faces, graft(Edges), Vertices
deg = Degrees(Radians=angle.Angle)
deg_2 = Degrees(Radians=angle_2.Angle)
angle_3 = Angle(VectorA=ln_8, VectorB=ln_7, Plane=xy_3)  # -> Angle, Reflex
angle_4 = Angle(VectorA=ln_10, VectorB=ln_9, Plane=xy_4)  # -> Angle, Reflex

# ---- group: camera
brep_2 = Brep(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)
debrep_2 = DeconstructBrep(Brep=brep_2)  # -> Faces, graft(Edges), Vertices
item = ListItem(List=debrep_2.Vertices, Index="2", Wrap=True)
vec2pt_3 = Vector2Pt(PointA=item, PointB=end_6.Start, Unitize=False)  # -> Vector, Length
move_7 = Move(Geometry=debrep_2.Edges, Motion=vec2pt_3.Vector)  # -> Geometry, Transform
xy_5 = XYPlane(Origin=end_6.Start)
rotate = Rotate(Geometry=move_7.Geometry, Angle=angle_4.Angle, Plane=xy_5)  # -> Geometry, Transform
item_2 = ListItem(List=rotate.Geometry, Index=Slider(359, range=0..359), Wrap=True)

# ----
bnd = Bounds(Numbers=deg)
bnd_2 = Bounds(Numbers=deg_2)
item_3 = ListItem(List=debrep.Vertices, Index="2", Wrap=True)
deg_3 = Degrees(Radians=angle_3.Angle)
deg_4 = Degrees(Radians=angle_4.Angle)
vec2pt_4 = Vector2Pt(PointA=item_3, PointB=end_5.Start, Unitize=False)  # -> Vector, Length
panel = Panel(bnd)
panel_2 = Panel(bnd_2)
move_8 = Move(Geometry=debrep.Edges, Motion=vec2pt_4.Vector)  # -> Geometry, Transform
xy_6 = XYPlane(Origin=end_5.Start)
addition = Addition(A=Slider(90, range=0..100), B=deg)
subtraction = Subtraction(A=deg_3, B=deg_3)
addition_2 = Addition(A=Slider(90, range=0..100), B=deg_2)
subtraction_2 = Subtraction(A=deg_4, B=deg_4)
rotate_2 = Rotate(Geometry=move_8.Geometry, Angle=angle_3.Angle, Plane=xy_6)  # -> Geometry, Transform
item_4 = ListItem(List=rotate_2.Geometry, Index=Slider(164, range=0..359), Wrap=True)

# ---- group: Z-rot
num = Number(deg_3)

# ----
viewer = ParamViewer(num)

# ---- group: Y-rot
num_2 = Number(subtraction)

# ---- group: X-rot
num_3 = Number(addition)

# ---- group: Z-rot
num_4 = Number(deg_4)

# ----
viewer_2 = ParamViewer(num_4)

# ---- group: Y-rot
num_5 = Number(subtraction_2)

# ---- group: X-rot
num_6 = Number(addition_2)

# ----
pdecon = Deconstruct(Point=divide_2.Points)  # -> XComponent, YComponent, ZComponent
pdecon_2 = Deconstruct(Point=divide.Points)  # -> XComponent, YComponent, ZComponent
gh_cpython = GH_CPython(
    x=pdecon_2.XComponent,
    y=pdecon_2.YComponent,
    z=pdecon_2.ZComponent,
    x_Rot=num_3,
    y_Rot=num_2,
    z_Rot=num,
    path_out="Result_current_pt_to_next_pt",
    TF=Button())  # -> output; inputs x: list, y: list, z: list, x_Rot: list, y_Rot: list, z_Rot: list, path_out: list, TF: list
#   port path_out: [required] - [type = int] - [default = None] Descripe your input here * bullet point. * bullet point
#   port output: indicate your output description here. refers to a new line.
# ---------- gh_cpython: Python ----------
import math
a= []


path = "C:\Users\yoshioca\Desktop\\" + str(path_out) + ".csv"

for i in xrange(len(x)):
    pos = str(x[i]) + ", " +  str(y[i]) + ", " + str(z[i]) + ", "
    rot = str(x_Rot[i]) + ", " + str(y_Rot[i]) + "," + str(z_Rot[i])
    temp = pos + rot
    a.append(temp)
    if i < len(x)-1:
        a.append("\n")

# print(path)

if TF:
    f = open(path, "w")
    f.writelines(a)
    f.close
# ---------- end gh_cpython ----------
gh_cpython_2 = GH_CPython(
    x=pdecon.XComponent,
    y=pdecon.YComponent,
    z=pdecon.ZComponent,
    x_Rot=num_6,
    y_Rot=num_5,
    z_Rot=num_4,
    path_out="Result_pt_to_origin",
    TF=Button())  # -> output; inputs x: list, y: list, z: list, x_Rot: list, y_Rot: list, z_Rot: list, path_out: list, TF: list; same code as gh_cpython
